# Grasshopper definition 40091109_ghx060019_Surfaces_Introduction[autosave].gh (Grasshopper 0.8.66)

circradius = Slider(5.8, range=1..6)
tamir_curvelength = Number(0.3)
num = Number(20)
tamir_piperadius = Number(1)
circradius_2 = Receiver(circradius, DrawTag=True, DrawWires=1)
# Curves: Like Curves, Surfaces can be described both geometrically and numerically. The numeric description of any NURBS Surface can be understood as the "Parameter Space" of the Surface. This space is two dimensional and not necessarily tied to the Euclidean space of the modeling environment but is always tied to the topology of the surface which is a consequence of the geometry that created that surface. The bounds of this space is called the "Surface Domain" which can be navigated numerically through the native domain or through a "Reparameterized" domain that forces both dimension's bounds to be 0.0 and 1.0. The current value at which this navigation is possible is called the UV Coordinate.
# Interface Here: Adjust the sliders below to affect the Surface Evaluation and Visualization.
crvtoggle = BooleanToggle(False)
numpts = Slider(20, range=2..20)
curveheight = Slider(8, range=2..20)
dummy = VectorXYZ(XComponent=0, YComponent=0, ZComponent=0)  # -> Vector, Length
blnreparamaterize = BooleanToggle(True)
visplanescale = Slider(2.1, range=1..5)
uratio = Slider(0.75, range=0..1)
vratio = Slider(0.15, range=0..1)
fontsizemain = Slider(0.8, range=0.1..1)
fontsizesmall = Slider(0.4, range=0.1..1)
# Parameter Surface Creation: Creating unrolled and rescaled "Parameter Surface."
originpt = Point(Point(0, -3, 0))
# Surface Creation: Creating two curve types for subsequent surface creation: Circle and Helix.
basept = Point(Point(6, 6, 0))
num_2 = Number(1.5)
_12 = Integer(12)
_6 = Integer(6)
_3 = Integer(3)
integer = Integer(2)
multiplication = Multiplication(A=num, B=tamir_curvelength)
num_3 = Number(0.5)
multiplication_2 = Multiplication(A=num_2, B=tamir_piperadius)
vec = VectorXYZ(XComponent=_6, YComponent=expr("-y", integer), ZComponent=0)  # -> Vector, Length
blnreparamaterize_2 = Receiver(blnreparamaterize, DrawTag=True, DrawWires=1)
addition = Addition(A=num_3, B=multiplication_2)
range = Range(Domain=multiplication, Steps=numpts)
range_2 = Range(Domain=curveheight, Steps=numpts)
X = UnitX(Factor=circradius)
sum = Addition(VectorA=originpt, VectorB=vec.Vector, Unitize=False)  # -> Vector, Length
sum_2 = Addition(VectorA=basept, VectorB=X, Unitize=False)  # -> Vector, Length
f_x_y = F2(Function="x*cos(y)", X=circradius_2, Y=range)
f_x_y_2 = F2(Function="x*sin(y)", X=circradius_2, Y=range)
rectangle = Rectangle(Plane=sum.Vector, XSize=_12, YSize=_3, Radius=0)  # -> Rec, Length
vec_2 = VectorXYZ(XComponent=f_x_y, YComponent=f_x_y_2, ZComponent=range_2)  # -> Vector, Length
basept_2 = Receiver(basept, DrawTag=True, DrawWires=1)
explode = Explode(Curve=rectangle.Rec, Recursive=True)  # -> Segments, Vertices
cir = Circle(Plane=basept, Radius=circradius)
_1 = Integer(1)
_3_2 = Integer(3)
ln = Line(StartPoint=basept, EndPoint=sum_2.Vector)
sum_3 = Addition(VectorA=basept_2, VectorB=vec_2.Vector, Unitize=False)  # -> Vector, Length
U = Receiver(uratio, DrawTag=True, DrawWires=1)
V = Receiver(vratio, DrawTag=True, DrawWires=1)
item = ListItem(List=explode.Segments, Index=_1, Wrap=False)
item_2 = ListItem(List=explode.Segments, Index=_3_2, Wrap=False)
intcrv = Interpolate(Vertices=sum_3.Vector, Degree=3, Periodic=False)  # -> Curve, Length, Domain
crvtoggle_2 = Receiver(crvtoggle, DrawTag=True, DrawWires=1)
flip = Flip(Curve=item_2)  # -> Curve, Flag
loft = Loft(
    Curves=[flip.Curve, item],
    Options={Adjust=True, Closed=False, Rebuild=10, Refit=0.01, LoftType=0, LoftEnds=3, LoftSimp=0})
surfaceflat = Receiver(loft, DrawTag=True, DrawWires=1)
dispatch = Dispatch(List=cir, DispatchPattern=crvtoggle_2)  # -> ListA, ListB
dispatch_2 = Dispatch(List=intcrv.Curve, DispatchPattern=crvtoggle_2)  # -> ListA, ListB
clean = CleanTree(Data=[dispatch.ListA, dispatch_2.ListB], CleanInvalid=True, CleanEmpty=False)
flatten = FlattenTree(Data=clean, Path="{0}")
piperadius = Receiver(addition, DrawTag=True, DrawWires=1)
visscale = Receiver(visplanescale, DrawTag=True, DrawWires=1)
number = Number(0.75)
pipe = Pipe(Curve=flatten, Radius=piperadius)
# Surface Evaluation: Evaluating Surfaces at UV Coordinates and visualizing Surface Frame and Normal Vector.
surface = Receiver(pipe, DrawTag=True, DrawWires=1)
reparamsrf = Surface(reparameterize([surface, surfaceflat]))
srf = Surface([surface, surfaceflat])
dispatch_3 = Dispatch(List=reparamsrf, DispatchPattern=blnreparamaterize_2)  # -> ListA, ListB
dispatch_4 = Dispatch(List=srf, DispatchPattern=blnreparamaterize_2)  # -> ListA, ListB
clean_2 = CleanTree(Data=[dispatch_3.ListA, dispatch_4.ListB], CleanInvalid=True, CleanEmpty=True)
int = Domain²Components(Domain=clean_2)  # -> UMin, UMax, VMin, VMax
minus = Subtraction(FirstNumber=int.UMax, SecondNumber=int.UMin)
minus_2 = Subtraction(FirstNumber=int.VMax, SecondNumber=int.VMin)
mult = Multiplication(FirstNumber=minus, SecondNumber=U)
mult_2 = Multiplication(FirstNumber=minus_2, SecondNumber=V)
add = Addition(FirstNumber=int.UMin, SecondNumber=mult)
add_2 = Addition(FirstNumber=int.VMin, SecondNumber=mult_2)
pt = PointXYZ(XComponent=add, YComponent=add_2, ZComponent=0)
eval = EvaluateSurface(Surface=clean_2, Point=pt)  # -> Point, Normal, Frame
iso = IsoCurve(Surface=clean_2, UVPoint=pt)  # -> UIsocurve, VIsocurve
mult_3 = Multiplication(FirstNumber=number, SecondNumber=visscale)
mul = Multiply(Vector=eval.Normal, Factor=[-0.05, 0.05])  # -> Vector, Length
isocrv = Curve([iso.UIsocurve, iso.VIsocurve])
number_2 = Number(0.25)
divide = DivideDistance(Curve=isocrv, Distance=number_2)  # -> Points, Tangents, Parameters
move = Move(Geometry=eval.Frame, Translation=mul.Vector)
rectangle_2 = Rectangle(Plane=move, XSize=mult_3, YSize=mult_3, Radius=0)  # -> Rec, Length
pcomp = PlaneComponents(Plane=move)  # -> Origin, XAxis, YAxis, ZAxis
cull = CullPattern(List=divide.Points, CullPattern=[True, False])
cull_2 = CullPattern(List=divide.Points, CullPattern=[False, True])
visscale_2 = Receiver(visplanescale, DrawTag=True, DrawWires=1)
mul_2 = Multiply(Vector=pcomp.XAxis, Factor=visscale_2)  # -> Vector, Length
mul_3 = Multiply(Vector=pcomp.YAxis, Factor=visscale_2)  # -> Vector, Length
mul_4 = Multiply(Vector=pcomp.ZAxis, Factor=visscale_2)  # -> Vector, Length
ln_2 = Line(StartPoint=cull, EndPoint=cull_2, DataComparison="shortest_list")
rev = Reverse(Vector=mul_2.Vector)
rev_2 = Reverse(Vector=mul_3.Vector)
mul_5 = Multiply(Vector=mul_4.Vector, Factor=[-1, 1])  # -> Vector, Length
planar = PlanarSrf(Edges=rectangle_2.Rec)
dummyvector = Receiver(dummy.Vector, DrawTag=True, DrawWires=1)
dummyvector_2 = Receiver(dummy.Vector, DrawTag=True, DrawWires=1)
dummyvector_3 = Receiver(dummy.Vector, DrawTag=True, DrawWires=1)
dashedline = Receiver(ln_2, DrawTag=True, DrawWires=1)
fontsize = Receiver(fontsizemain, DrawTag=True, DrawWires=1)
originpt_2 = Receiver(pcomp.Origin, DrawTag=True, DrawWires=1)
xvector = Receiver(rev, DrawTag=True, DrawWires=1)
originpt_3 = Receiver(pcomp.Origin, DrawTag=True, DrawWires=1)
originpt_4 = Receiver(pcomp.Origin, DrawTag=True, DrawWires=1)
fontsize_2 = Receiver(fontsizesmall, DrawTag=True, DrawWires=1)
circline = Receiver(ln, DrawTag=True, DrawWires=1)
yvector = Receiver(pcomp.YAxis, DrawTag=True, DrawWires=1)
zvector = Receiver(mul_5.Vector, DrawTag=True, DrawWires=1)
radline = Receiver(ln, DrawTag=True, DrawWires=1)
# Visualization: The sliders, previews, and tags below are for visualization.
geom = Receiver([basept, flatten, planar], DrawTag=True, DrawWires=1)
srfpt = Receiver(pcomp.Origin, DrawTag=True, DrawWires=1)
uvpt = Receiver(pt, DrawTag=True, DrawWires=1)
pcomp_2 = Decompose(Point=uvpt)  # -> XComponent, YComponent, ZComponent
xz = XZPlane(Origin=srfpt)
eval_2 = EvaluateCurve(Curve=reparameterize(radline), Parameter=0.5)  # -> Point, Tangent, Length
len = Length(Curve=radline)
preview = CustomPreview(Geometry=flatten(geom), Shader=ColourSwatch(SwatchColor=RGB(255, 255, 255)))
preview_2 = CustomPreview(Geometry=circline, Shader=ColourSwatch(SwatchColor=RGB(130, 130, 130)))
preview_3 = CustomPreview(Geometry=dashedline, Shader=ColourSwatch(SwatchColor=RGB(235, 0, 255)))
dis = VectorDisplay(Anchors=originpt_2, Vectors=[xvector, dummyvector], stops=[0: None, 0: None, 0: None])
dis_2 = VectorDisplay(Anchors=originpt_3, Vectors=[dummyvector_3, yvector], stops=[0: None, 0: None, 0: None])
dis_3 = VectorDisplay(Anchors=originpt_4, Vectors=[dummyvector_2, zvector], stops=[0: None, 0: None, 0: None])
f_x = F1(Function="Round(x,2)", X=pcomp_2.YComponent)
f_x_2 = F1(Function="Round(x,2)", X=pcomp_2.XComponent)
f_x_3 = F1(Function="Round(x,2)", X=len)
f_x_y_3 = F2(Function="Format(\"(u:{0}, v:{1})\", x, y}", X=f_x_2, Y=f_x)
f_x_4 = F1(Function="Format(\"r = {0} in\", x}", X=f_x_3)
tag = TextTag3D(Location=eval_2.Point, Text=f_x_4, Size=fontsize_2)
tag_2 = TextTag3D(Location=xz, Text=f_x_y_3, Size=fontsize)
