# Grasshopper definition angkor.gh (Grasshopper 0.9.14)
# plug-ins: WeaverBird

toggle = BooleanToggle(False)
a1 = Number(0.4)
a5 = Number(9)
a3 = Number(3)
a4 = Number(0.5)
a2 = Number(20)
necklace_connector_thikness = Number(1.7)
stroke = Slider(1.4, range=0.4..1.4)
wave = Slider(0.5, range=0.5..3)
simmetry = Slider(3, range=1..6)
density = Slider(20, range=1..20)
pattern = Slider(9, range=2..50)
xy = XYPlane(Origin=Point(0, 0, 0))
cir = Circle(Plane=xy, Radius=20)
necklace = Necklace(connector_thikness=necklace_connector_thikness)
base_curves = BaseCurves(crv=cir, num=a2, seed=a5)
cylinders = Cylinders(C=base_curves, num_2=a1, num=a3, num_3=a4, C_2=cir)
bbox_points = BboxPoints(C=necklace)  # -> E, E_2
wbsplitquads = WeaverBirdsConstantQuadsSubdivision(MeshCurves=cylinders, Level=1, SmoothNakedEdges=1)  # -> flatten(OutputMeshCurves); disabled
wbloop = WeaverBirdsLoopSubdivision(MeshCurves=wbsplitquads, Level=1, SmoothNakedEdges=1)  # -> flatten(OutputMeshCurves); disabled
division = Division(A=necklace_connector_thikness, B=2)
wbcatmullclark = WeaverBirdsCatmullClarkSubdivision(MeshCurves=cylinders, Level=1, SmoothNakedEdges=1)  # -> flatten(OutputMeshCurves)
bbox_points_2 = BboxPoints(C=wbcatmullclark)  # -> E, E_2
subtraction = Subtraction(A=bbox_points.E, B=bbox_points_2.E_2)
move = Move(Geometry=flatten(wbcatmullclark), Motion=subtraction)  # -> Geometry, Transform
vec = VectorXYZ(XComponent=0, YComponent=division, ZComponent=0)  # -> Vector, Length
move_2 = Move(Geometry=move.Geometry, Motion=vec.Vector)  # -> Geometry, Transform
all = Geometry([move_2.Geometry, necklace])

# ==== cluster Necklace
cat = Catenary(PointA=Point(7, 56, 0), PointB=Point(23, 56, 0), Length=43.7, Gravity=Vector(0, -1, 0))
divdist = DivideDistance(Curve=cat, Distance=0.7)  # -> Points, Tangents, Parameters
torus = TorusSurface(
    UDivisions=10,
    VDivisions=10,
    CParameter=2,
    RParameter=0.8,
    TParameter=1,
    Scale=0.28,
    Domain1=Domain(0, 6.283185307),
    Domain2=Domain(-3.141592654, 3.141592654))
rad = Radians(Degrees=90)
connector_thikness = ClusterInput()
pframe = PerpFrame(Curve=cat, Parameter=divdist.Parameters)
move = Move(Geometry=torus, Motion=divdist.Points)  # -> Geometry, Transform
sift = SiftPattern(List=move.Geometry, SiftPattern=[0, 1, 0, 1])  # -> Output0, Output1
torus_2 = TorusSurface(
    UDivisions=10,
    VDivisions=10,
    CParameter=4,
    RParameter=connector_thikness,
    TParameter=2,
    Scale=0.3,
    Domain1=Domain(0, 6.283185307),
    Domain2=Domain(-3.141592654, 3.141592654))
rotate = Rotate(Geometry=sift.Output0, Angle=rad, Plane=pframe)  # -> Geometry, Transform
xz = XZPlane(Origin=Point(0, 0, 0))
rad_2 = Radians(Degrees=90)
geo = Geometry([rotate.Geometry, sift.Output1])
move_2 = Move(Geometry=geo, Motion=Vector(0, 0, 1.4))  # -> Geometry, Transform
rotate_2 = Rotate(Geometry=torus_2, Angle=rad_2, Plane=xz)  # -> Geometry, Transform
move_3 = Move(Geometry=rotate_2.Geometry, Motion=Vector(15, 36.5, 1.6))  # -> Geometry, Transform
geo_2 = Geometry(simplify(flatten([move_3.Geometry, move_2.Geometry])))
geo_3 = ClusterOutput(geo_2)

# ==== cluster BboxPoints
C = ClusterInput()
bbox = BoundingBox(Content=C, Plane=PlaneXY(0, 0, 0), UnionBox=True)  # -> Box, Box_2
explode = BrepComponents(Brep=bbox.Box)  # -> Faces, Edges, Vertices
pcen = PolygonCenter(Polyline=explode.Faces)  # -> CenterV, CenterE
item = ListItem(List=pcen.CenterV, Index=Slider(0, range=0..12), Wrap=False)
item_2 = ListItem(List=pcen.CenterV, Index=Slider(2, range=0..12), Wrap=False)
E = ClusterOutput(item)
E_2 = ClusterOutput(item_2)

# ==== cluster BaseCurves
seed = ClusterInput()
num = ClusterInput()
crv = ClusterInput()
num_2 = Number(seed)
num_3 = Number(num)
crv_2 = Curve(crv)
multiplication = Multiplication(A=num_2, B=27)
len = Length(Curve=crv_2)
eval = Evaluate(F="x-10", x=len)
dom = Domain(DomainStart=0, DomainEnd=len)
dom_2 = Domain(DomainStart=10, DomainEnd=eval)
random = Random(Range=dom, Number=num_3, Seed=num_2)
random_2 = Random(Range=dom_2, Number=num_3, Seed=multiplication)
addition = Addition(A=random, B=random_2)
hframe = HorizontalFrame(Curve=crv_2, Parameter=random)
hframe_2 = HorizontalFrame(Curve=crv_2, Parameter=addition)
ln = Line(StartPoint=hframe, EndPoint=hframe_2)
L = ClusterOutput(ln)

# ==== cluster Cylinders
C = ClusterInput()
C_2 = ClusterInput()
num = ClusterInput()
num_2 = ClusterInput()
num_3 = ClusterInput()
expression = Expression(x=num_2, Expression="floor((x-0.4)*12+6)")
num_4 = Number(num)
num_5 = Number(num_2)
num_6 = Number(num_3)
xy = XYPlane(Origin=Point(0, 0, 0))
eval = Evaluate(F="360/x", x=num_4)
eval_2 = Evaluate(F="(x*1.4)", x=num_5)
divlength = DivideLength(Curve=C_2, Length=eval_2)  # -> Points, Tangents, Parameters
series = Series(Start=0, Step=eval, Count=num_4)
dist = Distance(PointA=xy, PointB=divlength.Points)
divlength_2 = DivideLength(Curve=C, Length=eval_2)  # -> simplify(flatten(Points)), Tangents, Parameters
dist_2 = Distance(PointA=xy, PointB=divlength_2.Points)
eval_3 = Evaluate(F="0.25 + ((1 + sin(x*y)) / 2)", x=dist_2, y=num_6)
eval_4 = Evaluate(F="0.25 + ((1 + sin(x*y)) / 2)", x=dist, y=num_6)
wbprism = WeaverBirdsMeshPrism(
    Plane=PlaneXY(0, 0, 0),
    Width=num_5,
    NumberOfSides=expression,
    TopPoint=Point(0, 0, 1),
    BasePolygonMethod=True,
    FillStrategy=2)
rad = Radians(Degrees=90)
rad_2 = Radians(Degrees=series)  # -> graft(Radians)
mesh_cylinder_vb = MeshCylinderVB(x=num_5)  # -> out, A
# ---------- mesh_cylinder_vb: VB ----------
    Dim radius As Double
    Dim faces As Integer
    radius = x
    'Math.Floor(((Math.Floor(radius * 10) - 1) / 2.0)) + 1)*6
    'faces = Math.Floor(((Math.Floor(radius * 10) - 1) / 2.0)) + 1)*6
    faces = (Math.floor((Math.Floor(radius * 10) - 1) / 2.0) + 1) * 6
    Dim circle As Circle
    Dim cylinder As Cylinder
    Dim mesh As Mesh
    Dim p As Plane = Rhino.Geometry.Plane.WorldXY
    p.OriginX = -10
    p.OriginY = -10
    'New Rhino.Geometry.Circle(
    circle = New Rhino.Geometry.Circle(p,radius)
    cylinder = New Rhino.Geometry.Cylinder(circle, 1)
    mesh = Rhino.Geometry.Mesh.CreateFromCylinder(cylinder, 3, faces)
    A = RhinoDoc.ActiveDoc.Objects.AddMesh(mesh)
# ---------- end mesh_cylinder_vb ----------
scale_nu = ScaleNU(Geometry=mesh_cylinder_vb.A, Plane=PlaneXY(0, 0, 0), ScaleX=1, ScaleY=1, ScaleZ=eval_4)  # -> Geometry, Transform
scale_nu_2 = ScaleNU(Geometry=mesh_cylinder_vb.A, Plane=PlaneXY(0, 0, 0), ScaleX=1, ScaleY=1, ScaleZ=eval_3)  # -> Geometry, Transform
move = Move(Geometry=scale_nu_2.Geometry, Motion=divlength_2.Points)  # -> simplify(flatten(Geometry)), Transform
move_2 = Move(Geometry=scale_nu.Geometry, Motion=divlength.Points)  # -> simplify(flatten(Geometry)), Transform
xy_2 = XYPlane(Origin=Point(-10, -10, 0))
rotate = Rotate(Geometry=move.Geometry, Angle=rad_2, Plane=xy_2)  # -> Geometry, Transform
geo = Geometry(simplify(flatten([move_2.Geometry, rotate.Geometry])))
bbox = BoundingBox(Content=geo, Plane=PlaneXY(0, 0, 0), UnionBox=True)  # -> Box, Box_2
rotate_2 = Rotate(Geometry=geo, Angle=rad, Plane=xy_2)  # -> Geometry, Transform
G = ClusterOutput(rotate_2.Geometry)
