# Grasshopper definition another.gh (Grasshopper 0.9.6)
# plug-ins: Python Interpreter, WeaverBird

c_script = CSharpScript()  # -> out, A
# ---------- c_script: C# ----------
    A = @"C:\inetpub\ftproot\Rendering_Data\GH_Def_files\args_" + System.Diagnostics.Process.GetCurrentProcess().Id + ".txt";
# ---------- end c_script ----------
file = ReadFile(Path=c_script.A, Lines=True)
item = ListItem(List=file, Index=0, Wrap=False)
item_2 = ListItem(List=file, Index=3, Wrap=False)
item_3 = ListItem(List=file, Index=1, Wrap=False)
item_4 = ListItem(List=file, Index=2, Wrap=False)
slider = Slider(5, range=5..30)
slider_2 = Slider(6, range=3..8)
slider_3 = Slider(6, range=3..8)
slider_4 = Slider(6, range=3..8)
c_script_2 = CSharpScript(x=item_2)  # -> out, A
# ---------- c_script_2: C# ----------
    String s = (String) x;
    Double d = Double.Parse(s);
    A = (int) Math.Floor(d * 3.0);
# ---------- end c_script_2 ----------
c_script_3 = CSharpScript(x=item_3)  # -> out, A
# ---------- c_script_3: C# ----------
    String s = (String) x;
    Double d = Double.Parse(s);
    A = (Double) ((d * 60.0) + 5);
# ---------- end c_script_3 ----------
c_script_4 = CSharpScript(x=item)  # -> out, A
# ---------- c_script_4: C# ----------
    String s = (String) x;
    Double d = Double.Parse(s);
    A = (int) ((d * 6.0) + 3);
# ---------- end c_script_4 ----------
c_script_5 = CSharpScript(x=item_4)  # -> out, A
# ---------- c_script_5: C# ----------
    String s = (String) x;
    Double d = Double.Parse(s);
    A = (int) ((d * 6.0) + 1);
# ---------- end c_script_5 ----------
c_script_6 = CSharpScript(x=item_3)  # -> out, A
# ---------- c_script_6: C# ----------
    String s = (String) x;
    Double d = Double.Parse(s);
    A = (Double) ((d * 8.0) + 1);
# ---------- end c_script_6 ----------
division__x = Integer(c_script_2.A)
wall_width = Number(c_script_3.A)
sides = Integer(c_script_4.A)
width = Number(c_script_6.A)
divisions = Integer(c_script_5.A)
series = Series(Start=Slider(1.718, range=0.3..3), Step=sides, Count=Slider(1, range=1..10))
addition = Addition(A=Slider(6, range=0..6), B=series)
multiplication = Multiplication(A=sides, B=divisions)
polygon = Polygon(Plane=PlaneXY(0, 0, 0), Radius=addition, Segments=sides, FilletRadius=0)  # -> graft(Polygon), Length
polygon_2 = Polygon(Plane=PlaneXY(0, 0, 0), Radius=series, Segments=sides, FilletRadius=0)  # -> graft(Polygon), Length
divide = DivideCurve(Curve=polygon_2.Polygon, Count=multiplication, Kinks=False)  # -> Points, Tangents, Parameters
divide_2 = DivideCurve(Curve=polygon.Polygon, Count=multiplication, Kinks=False)  # -> Points, Tangents, Parameters
rdiff = RegionDifference(CurvesA=polygon.Polygon, CurvesB=polygon_2.Polygon)
ln = Line(StartPoint=divide.Points, EndPoint=divide_2.Points)  # -> flatten(Line)
ln_2 = Line(StartPoint=divide.Points, EndPoint=divide_2.Points)  # -> flatten(Line)
c_script_7 = CSharpScript(lines=ln_2)  # -> out, A; inputs lines: list of Line; disabled
# ---------- c_script_7: C# ----------
    
    
    List<Polyline> poly = new List<Polyline>();
    lines.Add(lines[0]);
    for(int i = 0; i < lines.Count - 1; i++)
    {
      List<Point3d> points = new List<Point3d>();
      points.Add(lines[i].From);
      points.Add(lines[i + 1].From);
      points.Add(lines[i + 1].To);
      points.Add(lines[i].To);
      points.Add(lines[i].From);

      poly.Add(new Polyline(points));
    }
    A = poly;
# ---------- end c_script_7 ----------
shift = ShiftList(List=ln, Shift=1, Wrap=True)
python = PythonScript()  # -> out, a; inputs x: list; disabled
# ---------- python: Python ----------
import rhinoscriptsyntax as rs
a=[]
x.append(x[0])
for i in range(len(x)-1):
    #l1 = rs.AddLine(rs.CurveStartPoint(x[i]),rs.CurveStartPoint(x[i+1]))
    l = rs.AddPolyline([rs.CurveStartPoint(x[i]),rs.CurveStartPoint(x[i+1]),rs.CurveEndPoint(x[i+1]),rs.CurveEndPoint(x[i]),rs.CurveStartPoint(x[i])])
    a.append(l)
# ---------- end python ----------
curvepoint = PointOnCurve(ln_2, parameter=1)
curvepoint_2 = PointOnCurve(shift, parameter=0)
curvepoint_3 = PointOnCurve(ln_2, parameter=0)
curvepoint_4 = PointOnCurve(shift, parameter=1)
Z = UnitZ(Factor=2)
pt = Point(simplify(graft(curvepoint_3)))
pt_2 = Point(simplify(graft(curvepoint)))
pt_3 = Point(simplify(graft(curvepoint_2)))
pt_4 = Point(simplify(graft(curvepoint_4)))
vec = VectorXYZ(XComponent=-5, YComponent=20, ZComponent=2)  # -> Vector, Length
pline = PolyLine(Vertices=[pt_3, pt, pt_2, pt_4], Closed=True)
planar = PlanarSrf(Edges=pline)
smesh = SimpleMesh(Brep=planar)  # -> flatten(Mesh)
mjoin = MeshJoin(Meshes=smesh)
wbcatmullclark = WeaverBirdsCatmullClarkSubdivision(MeshCurves=mjoin, Level=division__x, SmoothNakedEdges=0)
wbcarpet = WeaverBirdsSierpinskiCarpet(MeshPolylines=wbcatmullclark, Distance=wall_width, InsetType=0)
wbthicken = WeaverBirdsMeshThicken(Mesh=wbcarpet, Distance=1, OffsetType=0)
stam = WeaverBirdsCatmullClarkSubdivision(MeshCurves=wbthicken, Level=3, SmoothNakedEdges=1)
wblaplace = WeaverBirdsLaplacianSmoothing(MeshCurves=stam, Level=1, SmoothNakedEdges=1, Thin=1)
scale = Scale(Geometry=wblaplace, Center=Point(0, 0, 0), Factor=3)  # -> Geometry, Transform
move = Move(Geometry=scale.Geometry, Motion=vec.Vector)  # -> Geometry, Transform
all = Geometry(move.Geometry)
