# Grasshopper definition brace1.gh (Grasshopper 0.8.66)

outerradius_sl = Slider(7.5, range=5..12)
slider = Slider(20, range=5..20)
slider_2 = Slider(1, range=1..10)
slider_3 = Slider(0.2, range=0.2..1.2)
slider_4 = Slider(15, range=15..40)
slider_5 = Slider(4, range=4..30)
cpipew = Number(0.13)
numdivisions = Number(0.68)
ringradius = Number(15)
numcircles = Number(0.61)
outerradius = Number(0.03)
pipewidth = Number(0.47)
innerradius = Number(0.99)
inpipew = Number(0.13)
f_x = F1(Function="x+0.2", X=cpipew)
f_x_2 = F1(Function="x+0.2", X=inpipew)
f_x_3 = F1(Function="floor(x*10)+7", X=numcircles)
f_x_4 = F1(Function="(x*7)+5", X=outerradius)
f_x_5 = F1(Function="floor((x*15)+5)", X=numdivisions)
f_x_6 = F1(Function="x+0.2", X=pipewidth)
f_x_7 = F1(Function="(x*9)+1", X=innerradius)
Y = UnitY(Factor=1)
pt = PointXYZ(XComponent=0, YComponent=0, ZComponent=ringradius, System=PlaneXY(0, 0, 0))
circle = CircleCNR(Center=pt, Normal=Y, Radius=ringradius)
divide = DivideCurve(Curve=circle, Count=f_x_3, Kinks=False)  # -> Points, Tangents, Parameters
frame = CurveFrame(Curve=circle, Parameter=divide.Parameters)
pcomp = PlaneComponents(Plane=frame)  # -> Origin, XAxis, YAxis, ZAxis
circle_2 = CircleCNR(Center=pcomp.Origin, Normal=pcomp.YAxis, Radius=f_x_4)
circle_3 = CircleCNR(Center=pcomp.Origin, Normal=pcomp.YAxis, Radius=f_x_7)
divide_2 = DivideCurve(Curve=circle_2, Count=f_x_5, Kinks=False)  # -> Points, Tangents, Parameters
divide_3 = DivideCurve(Curve=circle_3, Count=f_x_5, Kinks=False)  # -> Points, Tangents, Parameters
ln = Line(StartPoint=divide_3.Points, EndPoint=divide_2.Points)
num = Number(f_x_6)

# ---- group: pipes
p2 = Pipe(Curve=ln, Radius=f_x, Caps=2)  # -> flatten(Brep)
p1 = Pipe(Curve=circle_3, Radius=num, Caps=0)  # -> flatten(Brep)
p3 = Pipe(Curve=circle_2, Radius=f_x_2, Caps=0)  # -> flatten(Brep)

# ----
all = BrepJoin(Breps=[p1, p2, p3])  # -> Breps, Closed
