# Grasshopper definition brace2.gh (Grasshopper 0.8.66)

outerradius_sl = Slider(7.5, range=5..12)
slider = Slider(20, range=5..20)
slider_2 = Slider(1, range=1..10)
slider_3 = Slider(0.2, range=0.2..1.2)
slider_4 = Slider(15, range=15..40)
slider_5 = Slider(4, range=4..30)
inringradius = Number(1)
ringradius = Number(15)
numdivisions = Number(0.4)
inpipewidth = Number(0.3)
outpipewidth = Number(1)
outerradius = Number(0.6)
numcircles = Number(0.5)
innerradius = Number(0.2)
pipewidth = Number(0.3)
shift = Number(0.5)
f_x_y = F2(Function="x+(y*3)", X=ringradius, Y=inringradius)
f_x = F1(Function="x+0.2", X=outpipewidth)
f_x_2 = F1(Function="floor(x*12)+7", X=numcircles)
f_x_3 = F1(Function="(x*7)+5", X=outerradius)
f_x_4 = F1(Function="floor((x*15)+5)", X=numdivisions)
f_x_y_2 = F2(Function="floor(x*y)", X=shift, Y=f_x_4)
f_x_5 = F1(Function="x+0.2", X=pipewidth)
f_x_6 = F1(Function="(x*9)+1", X=innerradius)
f_x_7 = F1(Function="x+0.2", X=inpipewidth)
pt = PointXYZ(XComponent=0, YComponent=0, ZComponent=ringradius, System=PlaneXY(0, 0, 0))
Y = UnitY(Factor=1)
circle = CircleCNR(Center=pt, Normal=Y, Radius=f_x_y)
circle_2 = CircleCNR(Center=pt, Normal=Y, Radius=ringradius)
divide = DivideCurve(Curve=circle, Count=f_x_2, Kinks=False)  # -> Points, Tangents, Parameters
frame = CurveFrame(Curve=circle, Parameter=divide.Parameters)
divide_2 = DivideCurve(Curve=circle_2, Count=f_x_2, Kinks=False)  # -> Points, Tangents, Parameters
frame_2 = CurveFrame(Curve=circle_2, Parameter=divide_2.Parameters)
pcomp = PlaneComponents(Plane=frame)  # -> Origin, XAxis, YAxis, ZAxis
pcomp_2 = PlaneComponents(Plane=frame_2)  # -> Origin, XAxis, YAxis, ZAxis
circle_3 = CircleCNR(Center=pcomp.Origin, Normal=pcomp.YAxis, Radius=f_x_6)
circle_4 = CircleCNR(Center=pcomp_2.Origin, Normal=pcomp_2.YAxis, Radius=f_x_3)
divide_3 = DivideCurve(Curve=circle_4, Count=f_x_4, Kinks=False)  # -> Points, Tangents, Parameters
divide_4 = DivideCurve(Curve=circle_3, Count=f_x_4, Kinks=False)  # -> Points, Tangents, Parameters
shift_2 = ShiftList(List=divide_3.Points, Shift=f_x_y_2, Wrap=True)
ln = Line(StartPoint=divide_4.Points, EndPoint=shift_2)

num = Number(f_x_5)
pipe = Pipe(Curve=ln, Radius=num, Caps=2)  # -> flatten(Brep)
pipe_2 = Pipe(Curve=circle_3, Radius=f_x_7, Caps=0)  # -> flatten(Brep)
pipe_3 = Pipe(Curve=circle_4, Radius=f_x, Caps=0)  # -> flatten(Brep)

all1 = BrepJoin(Breps=[pipe_2, pipe, pipe_3])  # -> Breps, Closed
bbox = BoundingBox(Content=all1.Breps, Union=True, Plane=PlaneXY(0, 0, 0))  # -> Box, Box_2
box_corners = BoxCorners(Box=bbox.Box)  # -> CornerA, CornerB, CornerC, CornerD, CornerE, CornerF, CornerG, CornerH
pcomp_3 = Decompose(Point=box_corners.CornerA, System=PlaneXY(0, 0, 0))  # -> XComponent, YComponent, ZComponent
neg = Negative(Value=pcomp_3.ZComponent)
pt_2 = PointXYZ(XComponent=0, YComponent=0, ZComponent=neg, System=PlaneXY(0, 0, 0))
all = Move(Geometry=all1.Breps, Motion=pt_2)  # -> Geometry, Transform
