# Grasshopper definition iPhone_txt_tst.gh (Grasshopper 0.9.14)

front_location_x = Slider(10, range=5..20)
front_location_y = Slider(10, range=0..100)
front_location_z = Slider(3, range=0..3)
font = Panel("Moonracer")  # disabled
fudge_logo_location = ValueList({"One": 0, "Two": 1, "Three": 2}, selected=[], ListIndex=0, UIMode=1)

# ---- group: Size
size_side = Slider(4.5, range=0..11)
plugin_1_size = Slider(4.2, range=0..11)
size_front = Slider(7.3, range=0..11)
size_inside = Slider(5, range=0..11)
plugin_2_size = Slider(4.4, range=0..11)

# ----
side_x = Slider(58, range=40..60)
side_y = Slider(24, range=10..80)
side_z = Slider(-7, range=-8..0)
toggle_bold = BooleanToggle(True)
toggleitalics = BooleanToggle(True)
inside_x = Slider(-1.4, range=-3..0)
inside_y = Slider(73, range=20..80)
inside_z = Slider(-3, range=-12..0)
font_2 = String("Comic Sans MS")
textparam = String("ThingsMakerSababa")
join = StringJoin(Strings=textparam)
jonathancluster = JonathanCluster(
    italics=toggleitalics,
    face=font_2,
    bold=toggle_bold,
    G=fudge_logo_location,
    _0=size_front,
    _1=size_side,
    content=join,
    _2=size_inside,
    _3=plugin_1_size,
    _4=plugin_2_size,
    X=front_location_x,
    Y=front_location_y,
    G_2=fudge_logo_location,
    Z=front_location_z,
    X_2=inside_x,
    Y_2=inside_y,
    Z_2=inside_z,
    X_3=side_x,
    Y_3=side_y,
    Z_3=side_z)  # -> G_4, G_3
mjoin = MeshJoin(Meshes=jonathancluster.G_3)
x_centerlizer_right_from_case = Number(4)
x_centerlizer_left_from_case = Number(52)
tm_all = Geometry(jonathancluster.G_3)
rising_z_to_be_on_case = UnitZ(Factor=11.5)
bbox = BoundingBox(Content=mjoin, Plane=PlaneXY(0, 0, 0))  # -> Box, Box_2
box_corners = BoxCorners(Box=bbox.Box_2)  # -> CornerA, CornerB, CornerC, CornerD, CornerE, CornerF, CornerG, CornerH
pcomp = Decompose(Point=box_corners.CornerA, System=PlaneXY(0, 0, 0))  # -> XComponent, YComponent, ZComponent
pcomp_2 = Decompose(Point=box_corners.CornerB, System=PlaneXY(0, 0, 0))  # -> XComponent, YComponent, ZComponent
text_width = Expression(x=pcomp.XComponent, y=pcomp_2.XComponent, Expression="abs(x-y)")
desired_width = Expression(x=x_centerlizer_left_from_case, y=x_centerlizer_right_from_case, Expression="abs(x-y)")
expression = Expression(x=text_width, y=desired_width, Expression="min(1,y/x)")
scale_nu = ScaleNU(Geometry=mjoin, Plane=PlaneXY(0, 0, 0), ScaleX=expression, ScaleY=expression, ScaleZ=1)  # -> Geometry, Transform
first_move = Move(Geometry=scale_nu.Geometry, Motion=rising_z_to_be_on_case)  # -> Geometry, Transform
bbox_2 = BoundingBox(Content=scale_nu.Geometry, Plane=PlaneXY(0, 0, 0))  # -> Box, Box_2
box_corners_2 = BoxCorners(Box=bbox_2.Box_2)  # -> CornerA, CornerB, CornerC, CornerD, CornerE, CornerF, CornerG, CornerH
expression_2 = Expression(x=x_centerlizer_left_from_case, y=x_centerlizer_right_from_case, Expression="(X + Y)/2")
pcomp_3 = Decompose(Point=box_corners_2.CornerA, System=PlaneXY(0, 0, 0))  # -> XComponent, YComponent, ZComponent
pcomp_4 = Decompose(Point=box_corners_2.CornerB, System=PlaneXY(0, 0, 0))  # -> XComponent, YComponent, ZComponent
expression_3 = Expression(x=pcomp_3.XComponent, y=pcomp_4.XComponent, Expression="(X + Y)/2")
subtraction = Subtraction(A=expression_2, B=expression_3)
X = UnitX(Factor=subtraction)
all = Move(Geometry=first_move.Geometry, Motion=X)  # -> Geometry, Transform
preview = CustomPreview(Shader=ColourSwatch(SwatchColor=RGB(0, 252, 38)))  # disabled

# ==== cluster JonathanCluster: ContainJonathanClusterJonathans original clusters a cluster of Grasshopper components
G = ClusterInput()
_0 = ClusterInput()
_1 = ClusterInput()
_2 = ClusterInput()
_3 = ClusterInput()
_4 = ClusterInput()
X = ClusterInput()
Y = ClusterInput()
Z = ClusterInput()
X_2 = ClusterInput()
Y_2 = ClusterInput()
Z_2 = ClusterInput()
X_3 = ClusterInput()
Y_3 = ClusterInput()
Z_3 = ClusterInput()
italics = ClusterInput()
face = ClusterInput()
bold = ClusterInput()
content = ClusterInput()
side_z = Slider(-1.9, range=-4..0)
side_y = Slider(41, range=20..80)
side_x = Slider(-1.2, range=-3..0)
G_2 = ClusterInput()
pt = PointXYZ(XComponent=side_x, YComponent=side_y, ZComponent=side_z, System=PlaneXY(0, 0, 0))
yz = YZPlane(Origin=pt)
rad = Radians(Degrees="180")
prot = RotatePlane(Plane=yz, Angle=rad)

filter = StreamFilter(Gate=G, Stream0=_0, Stream1=_1, Stream2=_2, Stream3=_3, Stream4=_4)
origin_point = Point(Point(0, 0, 0))
location_4 = Plane(PlaneYZ(0, 40, 0))
location_5 = Plane(PlaneYZ(0, 40, 0))
pt_2 = PointXYZ(XComponent=X, YComponent=Y, ZComponent=Z, System=PlaneXY(0, 0, 0))
pt_3 = PointXYZ(XComponent=X_2, YComponent=Y_2, ZComponent=Z_2, System=PlaneXY(0, 0, 0))
pt_4 = PointXYZ(XComponent=X_3, YComponent=Y_3, ZComponent=Z_3, System=PlaneXY(0, 0, 0))
yz_2 = YZPlane(Origin=pt_3)
yz_3 = YZPlane(Origin=pt_4)
rad_2 = Radians(Degrees="0")
padjust = AdjustPlane(Plane=yz_2, Normal=Vector(-12, 0, 0))
expression = Expression(x=filter, Expression="x/4")
prot_2 = RotatePlane(Plane=yz_3, Angle=rad_2)
Z_4 = UnitZ(Factor=expression)
xy = XYPlane(Origin=pt_2)
size_inside = Slider(5, range=0..11)
filter_2 = StreamFilter(Gate=G_2, Stream0=xy, Stream1=padjust, Stream2=prot_2, Stream3=location_4, Stream4=location_5)
xy_2 = XYPlane(Origin=Point(0, 0, 0))
c_script = CSharpScript(face="Moonracer", bold=Toggle(False), size=size_inside, content="fudged", pl=origin_point)  # -> out, A; inputs face: String, bold: Boolean, italics: Boolean, size: Double, content: String, pl: Plane
# ---------- c_script: C# ----------
    if(size == 0)
      size = 1;

    if(!string.IsNullOrEmpty(face) && size > 0 && !string.IsNullOrEmpty(content) &&
      pl.IsValid)
    {

      var te = RhinoDoc.ActiveDoc.Objects.AddText(content, pl, size, face, bold, italics);
      Rhino.DocObjects.TextObject txt = RhinoDoc.ActiveDoc.Objects.Find(te) as Rhino.DocObjects.TextObject;

      if(txt != null)
      {
        var tt = txt.Geometry as Rhino.Geometry.TextEntity;
        A = tt.Explode();
      }
      
      RhinoDoc.ActiveDoc.Objects.Delete(te, true);
    }
# ---------- end c_script ----------
Z_5 = UnitZ(Factor=filter)
planar = PlanarSrf(Edges=c_script.A)
extr = Extrude(Base=planar, Direction=Z_5)
cap = CapHoles(Brep=extr)
orient = Orient(Geometry=cap, Source=xy_2, Target=prot)  # -> Geometry, Transform

texttocurves = VBScript(face=face, bold=bold, italics=italics, size=filter, content=content, pl=origin_point)  # -> out, Curves_Out
# ---------- texttocurves: VB ----------
    If(size = 0) Then
      size = 1
    End If


    Dim letters_plane As Rhino.Geometry.Plane
    letters_plane = Rhino.Geometry.Plane.WorldXY

    If(face <> Nothing And size > 0 And content <> Nothing) Then
      Dim te As System.Guid
      te = RhinoDoc.ActiveDoc.Objects.AddText(content, letters_plane, size, face, bold, italics)

      Dim txt As Rhino.DocObjects.TextObject
      txt = RhinoDoc.ActiveDoc.Objects.Find(te)

      Dim tt As Rhino.Geometry.TextEntity
      tt = txt.Geometry

      Dim curves() As Rhino.Geometry.Curve
      curves = tt.Explode()

      Dim curvesNum As Integer
      curvesNum = curves.GetUpperBound(0)
      Print("srfc=" + curvesNum.ToString())

      Dim resList As New System.Collections.Generic.List(Of String)()

      For i As Integer = 0 To curvesNum
        Dim guid As System.Guid
        guid = RhinoDoc.ActiveDoc.Objects.AddCurve(curves(i))
        resList.Add(guid.ToString())
      Next

      Curves_Out = resList
      RhinoDoc.ActiveDoc.Objects.Delete(te, False)
    End If
# ---------- end texttocurves ----------

planar_2 = PlanarSrf(Edges=texttocurves.Curves_Out)
extr_2 = Extrude(Base=planar_2, Direction=Z_4)
cap_2 = CapHoles(Brep=extr_2)
orient_2 = Orient(Geometry=cap_2, Source=xy_2, Target=filter_2)  # -> Geometry, Transform

G_3 = ClusterOutput(orient_2.Geometry)
G_4 = ClusterOutput(orient.Geometry)
