# Grasshopper definition kipodyam[autosave].gh (Grasshopper 0.8.66)

p9 = Number(0.18)
p8 = Number(0.31)
p7 = Number(0.35)
p10 = Number(0.34)
p3 = Number(0.73)
p0 = Number(0.85)
p5 = Number(0.07)
p4 = Number(0.4)
p2 = Number(0.44)
p6 = Number(0.3)
p1 = Number(0.2)
num = Number(15)
f_x = F1(Function="x*9+1", X=p9)
f_x_2 = F1(Function="(x*7)+3", X=p0)
f_x_3 = F1(Function="x*2", X=p10)
f_x_4 = F1(Function="x*20+3", X=p4)
f_x_5 = F1(Function="x*20+3", X=p5)
f_x_6 = F1(Function="x/2", X=p2)
f_x_7 = F1(Function="x", X=p1)
f_x_8 = F1(Function="floor((x*100)+1)", X=p3)
f_x_9 = F1(Function="x*3", X=p6)
f_x_10 = F1(Function="x*2+1", X=p8)
f_x_11 = F1(Function="x", X=p7)
neg = Negative(Value=f_x_5)
neg_2 = Negative(Value=num)

# ---- group: ring
pt = PointXYZ(XComponent=num, YComponent=0, ZComponent=0, System=PlaneXY(0, 0, 0))
pt_2 = PointXYZ(XComponent=num, YComponent=1, ZComponent=0, System=PlaneXY(0, 0, 0))
rectangle = Rectangle(Plane=PlaneXY(0, 0, 0), XSize=f_x_10, YSize=f_x, Radius=f_x_3)  # -> Rectangle, Length
ln = Line(StartPoint=pt, EndPoint=pt_2)
division = Division(A=f_x, B=-2)
revsrf = Revolution(Curve=rectangle.Rectangle, Axis=ln, Domain=Domain(0, 6.283185307))
vec = VectorXYZ(XComponent=neg_2, YComponent=division, ZComponent=num)  # -> Vector, Length
ring = Move(Geometry=revsrf, Motion=vec.Vector)  # -> Geometry, Transform

# ----
pt_3 = PointXYZ(XComponent=0, YComponent=0, ZComponent=0, System=PlaneXY(0, 0, 0))

# ---- group: cones
neg_3 = Negative(Value=f_x_4)
dom = Domain(DomainStart=neg_3, DomainEnd=f_x_4)
dom_2 = Domain(DomainStart=neg, DomainEnd=f_x_5)
dom_3 = Domain(DomainStart=2, DomainEnd=5)
random = Random(Range=dom_3, Number=f_x_8, Seed=5, Integers=False)
random_2 = Random(Range=dom, Number=f_x_8, Seed=2, Integers=False)
random_3 = Random(Range=dom_2, Number=f_x_8, Seed=3, Integers=False)
pt_4 = PointXYZ(XComponent=random_2, YComponent=random_3, ZComponent=random, System=PlaneXY(0, 0, 0))
ln_2 = Line(StartPoint=pt_4, EndPoint=pt_3)
multiplication = Multiplication(A=num, B=2)
vec_2 = VectorXYZ(XComponent=0, YComponent=0, ZComponent=multiplication)  # -> Vector, Length

# ----
len = Length(Curve=ln_2)
eval = EvaluateLength(Curve=ln_2, Length=0.5, Normalized=True)  # -> Point, Tangent, Parameter
multiplication_2 = Multiplication(A=f_x_6, B=len)
circle = CircleCNR(Center=eval.Point, Normal=pt_4, Radius=multiplication_2)
crv = Curve(circle)
x_tremez = Extremes(Curve=crv, Plane=PlaneXY(0, 0, 0))  # -> Highest, Lowest
len_2 = Length(Curve=crv)
multiplication_3 = Multiplication(A=f_x_7, B=len_2)
crv_cp = CurveCP(Point=x_tremez.Highest, Curve=crv)  # -> Point, Parameter, Distance
addition = Addition(A=crv_cp.Parameter, B=multiplication_3)
eval_2 = EvaluateCurve(Curve=crv, Parameter=addition)  # -> Point, Tangent, Length
arc = Arc3Pt(PointA=pt_4, PointB=eval_2.Point, PointC=pt_3)  # -> Arc, Plane, Radius
pframes = PerpFrames(Curve=arc.Arc, Count=5, Align=True)  # -> Frames, Parameters
path_mapper = PathMapper(arc.Arc, source="{A;B} (i)", target="{i}")
len_3 = Length(Curve=path_mapper)
f_x_y_z = F3(Function="(x/y)*π*z", X=pframes.Parameters, Y=len_3, Z=f_x_9)
rotate = Rotate(Geometry=pframes.Frames, Angle=f_x_y_z, Plane=pframes.Frames)  # -> Geometry, Transform
polygon = Polygon(Plane=rotate.Geometry, Radius=f_x_11, Segments=f_x_2, FilletRadius=0)  # -> Polygon, Length

# ---- group: cones (continued)
swp1 = Sweep1(Rail=path_mapper, Sections=polygon.Polygon, Trim=True)
cap = CapHoles(Brep=swp1)
cones = Move(Geometry=cap, Motion=vec_2.Vector)  # -> Geometry, Transform

# ----
all = BrepJoin(Breps=[ring.Geometry, cones.Geometry])  # -> Breps, Closed
