# Grasshopper definition vase3.gh (Grasshopper 0.8.66)

rad1 = Number(0.7)
rad3 = Number(0.3)
rad2 = Number(0.3)
rad4 = Number(0.3)
all = PythonScript(rad1=rad1, rad2=rad2, rad3=rad3, rad4=rad4, GhMemory=-10)  # -> out, vase, spheres
# ---------- all: Python ----------
import math
import rhinoscriptsyntax as rs
import Rhino
import itertools

def Denary2Binary(n):
    '''convert denary integer n to binary string bStr'''
    bStr = ''
    if n < 0:  raise ValueError, "must be a positive integer"
    if n == 0: return '0'
    while n > 0:
        bStr = str(n % 2) + bStr
        n = n >> 1
    return bStr

def int2bin(n, count=24):
    """returns the binary of integer n, using count number of digits"""
    return "".join([str((n >> y) & 1) for y in range(count-1, -1, -1)])

def int2bool(n, count):
    binary = int2bin(n,count)
    return map(lambda x: int(x)==1, list(binary))
    
def create_patterns(surface, circle1, circle2, pattern1, pattern2, n_divisions):
    points = []
    for circle in [circle1, circle2]:
        divs = rs.DivideCurve(circle, n_divisions)
        points.append(divs)
    
    final_points = []
    for i in range(n_divisions):   
        if pattern1[i % len(pattern1)]:
            final_points.append(points[0][i]) 
        if pattern2[i % len(pattern2)]:
            final_points.append(points[1][i])         
    
    p = rs.AddInterpCrvOnSrf(surface, final_points)
    return p
                               
def project_spheres(curves, r, distance):
    spheres = []
    l = r * distance
    for crv in curves:
        points = rs.DivideCurveLength(crv, l)
        for point in points:
            spheres.append(rs.AddSphere(point, r))
    return spheres

def create_vase(rad, heights):
    p=[]
    for r,h in zip(rad, heights):
        p.append((r,0,h))
    crv = rs.AddInterpCurve(p)
    axis = rs.AddLine((0,0,0),(0,0,10))
    v = rs.AddRevSrf(crv, axis)
    return (v, crv)

def get_vase_circles(curve, n_circles):
    points = rs.DivideCurve(curve, n_circles)
    circles = []
    for p in points:
        c = rs.AddCircle(rs.MovePlane(rs.WorldXYPlane(), (0,0,p[2])), p[0])
        circles.append(c)
    return circles
    
def run(rad1, rad2, rad3, rad4, n_vertical_divs, n_horizontal_divs, pattern_length, pattern_value, sphere_rad, sphere_distance_ratio):
    
    
    rad = [rad1, rad2, rad3, rad4]
    heights = [0, 3, 6, 10]
    
    (vase, curve) = create_vase(rad, heights)
    circles = get_vase_circles(curve, n_vertical_divs)
    p1 = int2bool(2,2)
    p2 = int2bool(1,2)
    
    conn_pattern = int2bool(pattern_value, pattern_length*pattern_length)
    end = n_vertical_divs-1
    start = 1
    spheres = []
    while(start <= end):
        for i in range(pattern_length):
            for j in range(pattern_length):
                if(i+start > end or j+start > end): 
                    continue
                if conn_pattern[i*pattern_length + j]:
                    curve = create_patterns(vase, circles[i+start], circles[j+start], p1, p2, n_horizontal_divs)
                    spheres.append(project_spheres([curve], sphere_rad, sphere_distance_ratio))
                    
        start=start+pattern_length
    all_spheres = list(itertools.chain(*spheres))
    return (vase, all_spheres)

def normalize_inputs(rad1, rad2, rad3, rad4, n_vertical_divs, n_horizontal_divs, pattern_length, pattern_value, sphere_rad, sphere_distance_ratio):
    rad1 = rad1*6 + 1
    rad2 = rad2*6 + 1
    rad3 = rad3*6 + 1
    rad4 = rad4*6 + 1
    return (rad1, rad2, rad3, rad4, n_vertical_divs, n_horizontal_divs, pattern_length, pattern_value, sphere_rad, sphere_distance_ratio)
    
#rad1 = 0.25
#rad2 = 3
#rad3 = 2.8
#rad4 = 4
n_vertical_divs = 6
n_horizontal_divs = 16
pattern_length = 2
pattern_value = 3
sphere_rad = 0.1
sphere_distance_ratio = 3

rs.EnableRedraw(False)
(rad1, rad2, rad3, rad4, n_vertical_divs, n_horizontal_divs, pattern_length, pattern_value, sphere_rad, sphere_distance_ratio) = normalize_inputs(rad1, rad2, rad3, rad4, n_vertical_divs, n_horizontal_divs, pattern_length, pattern_value, sphere_rad, sphere_distance_ratio)
(vase, spheres) = run(rad1, rad2, rad3, rad4, n_vertical_divs, n_horizontal_divs, pattern_length, pattern_value, sphere_rad, sphere_distance_ratio)
print "n_sphers = %s" % len(spheres)
rs.EnableRedraw(True)
# ---------- end all ----------
c_script = CSharpScript(r1=rad1, r2=rad2, r3=rad3, r4=rad4)  # -> out, A; inputs r1: Double, r2: Double, r3: Double, r4: Double
# ---------- c_script: C# ----------
    r1 = r1 * 6 + 1;
    r2 = r2 * 6 + 1;
    r3 = r3 * 6 + 1;
    r4 = r4 * 6 + 1;

    Curve crv = CreateVaseCurve(r1, r2, r3, r4);
    RevSurface srf = CreateVase(crv);
    A = srf;
# ---------- c_script: C# additional code ----------
  private Curve CreateVaseCurve(double r1, double r2, double r3, double r4)
  {
    List<Point3d> points = new List<Point3d>(4);
    points.Add(new Point3d(r1, 0, 0));
    points.Add(new Point3d(r2, 0, 3));
    points.Add(new Point3d(r3, 0, 6));
    points.Add(new Point3d(r4, 0, 10));

    Curve crv = Curve.CreateInterpolatedCurve(points, 3);
    return crv;
  }
  private RevSurface CreateVase(Curve crv)
  {
    Line axis = new Line(new Point3d(0, 0, 0), new Point3d(0, 0, 10));
    RevSurface srf = Rhino.Geometry.RevSurface.Create(crv, axis);

    return srf;
  }
  /*private List<Circle> GetVaseCircles(Curve crv, int NumCircles)
  {

  }*/
# ---------- end c_script ----------
