# Grasshopper definition voronoi_tiles_pendant.gh (Grasshopper 0.9.14)
# plug-ins: WeaverBird, LunchBox

cat = Catenary(PointA=Point(7, 56, 0), PointB=Point(23, 56, 0), Length=43.7, Gravity=Vector(0, -1, 0))
divdist = DivideDistance(Curve=cat, Distance=0.7)  # -> Points, Tangents, Parameters
torus = TorusSurface(
    UDivisions=10,
    VDivisions=10,
    CParameter=2,
    RParameter=0.8,
    TParameter=1,
    Scale=0.28,
    Domain1=Domain(0, 6.283185307),
    Domain2=Domain(-3.141592654, 3.141592654))
rad = Radians(Degrees=90)
pframe = PerpFrame(Curve=cat, Parameter=divdist.Parameters)
move = Move(Geometry=torus, Motion=divdist.Points)  # -> Geometry, Transform
a1 = Number(0.4)
a0 = Number(0.4)
a2 = Number(0.4)
a3 = Number(0.4)
front_location_x = Slider(0, range=0..20)
front_location_y = Slider(12, range=0..100)
front_location_z = Slider(0, range=-50..3)
sift = SiftPattern(List=move.Geometry, SiftPattern=[0, 1, 0, 1])  # -> Output0, Output1
font = Panel("Moonracer")  # disabled
fudge_logo_location = ValueList({"One": 0, "Two": 1, "Three": 2}, selected=[], ListIndex=0, UIMode=1)

# ---- group: Size
size_side = Slider(4.5, range=0..11)
plugin_1_size = Slider(3.4, range=0..11)
size_front = Slider(7.5, range=0..11)
size_inside = Slider(5, range=0..11)
plugin_2_size = Slider(4.4, range=0..11)

# ----
side_x = Slider(58, range=40..60)
side_y = Slider(24, range=10..80)
side_z = Slider(-7, range=-8..0)
torus_2 = TorusSurface(
    UDivisions=10,
    VDivisions=10,
    CParameter=4,
    RParameter=1.7,
    TParameter=2,
    Scale=0.3,
    Domain1=Domain(0, 6.283185307),
    Domain2=Domain(-3.141592654, 3.141592654))
toggle_bold = BooleanToggle(True)
eval = Evaluate(F="floor(x*6)+3", x=a1)
eval_2 = Evaluate(F="(x*6)+1", x=a0, y=eval)
eval_3 = Evaluate(F="(x*37)+3", x=a2)
eval_4 = Evaluate(F="floor((x*12)+2)", x=a3)
inside_x = Slider(-1.4, range=-3..0)
inside_y = Slider(73, range=20..80)
inside_z = Slider(-3, range=-12..0)
textparam = String(["L", "O", "V", "E"])
rotate = Rotate(Geometry=sift.Output0, Angle=rad, Plane=pframe)  # -> Geometry, Transform
density = Integer(eval_2)
stroke = Number(eval_3)
xz = XZPlane(Origin=Point(0, 0, 0))
pattern = Number(eval_4)
rad_2 = Radians(Degrees=90)
order = Number(eval)
join = StringJoin(Strings=textparam)
voronoi_radius_not_interesting = Slider(100, range=2..100)
geo = Geometry([rotate.Geometry, sift.Output1])
move_2 = Move(Geometry=geo, Motion=Vector(0, 0, 1.4))  # -> Geometry, Transform

number_of_tiles = Slider(5, range=1..20)
density_2 = Slider(9, range=1..20)
stroke_2 = Slider(20, range=3..40)
density_3 = Integer(density)
order_2 = Number(order)

font_2 = String("Comic Sans MS")
slider = Slider(9, range=2..20)
rotate_2 = Rotate(Geometry=torus_2, Angle=rad_2, Plane=xz)  # -> Geometry, Transform
size = Slider(30, range=20..50)

slider_2 = Slider(26, range=5..50)
dom = Domain(DomainStart=Slider(12, range=0..30), DomainEnd=Slider(20, range=0..30))
dom_2 = Domain(DomainStart=3, DomainEnd=30)
random = Random(Range=dom_2, Number=slider_2, Seed=7)
random_2 = Random(Range=dom, Number=slider_2, Seed=2)
pt = PointXYZ(XComponent=random, YComponent=random_2, ZComponent=0, System=PlaneXY(0, 0, 0))  # disabled

move_3 = Move(Geometry=rotate_2.Geometry, Motion=Vector(15, 36.5, 1.6))  # -> Geometry, Transform
pattern_2 = Number(pattern)
size_2 = Number(size)
stroke_3 = Number(stroke)
cluster = Cluster(
    face=font_2,
    bold=toggle_bold,
    content=join,
    G=fudge_logo_location,
    _0=size_front,
    _1=size_side,
    _2=size_inside,
    _3=plugin_1_size,
    _4=plugin_2_size,
    X=front_location_x,
    Y=front_location_y,
    Z=front_location_z,
    X_2=inside_x,
    Y_2=inside_y,
    Z_2=inside_z,
    X_3=side_x,
    G_2=fudge_logo_location,
    Y_3=side_y,
    Z_3=side_z)
eval_5 = Evaluate(F="x/y", x=size_2, y=order_2)
eval_6 = Evaluate(F="max(1,floor(x/(y²)))", x=density_3, y=order_2)
num = Number(eval_5)
brep = Brep(cluster)
multiplication = Multiplication(A=num, B=order_2)
eval_7 = Evaluate(F="x/2", x=pattern_2)
dom_3 = Domain(DomainStart=0, DomainEnd=num)
mesh = MeshBrep(
    Brep=brep,
    Settings={Refine=True, JaggedSeams=False, SimplePlanes=True, GridMinCount=16, GridMaxCount=0, Tolerance=0, RefineAngle=0, MinTolerance=0, RelativeTolerance=0.65, MinEdgeLength=0.0001, MaxEdgeLength=0})
dom_4 = Domain(DomainStart=0, DomainEnd=multiplication)
wbsplitpolygons = WeaverBirdsSplitPolygonsSubdivision(MeshCurves=mesh, Level=2, SmoothNakedEdges=1)
rectangle = Rectangle(Plane=PlaneXY(0, 0, 0), XSize=dom_4, YSize=dom_4, Radius=0)  # -> Rectangle, Length
Z = UnitZ(Factor=1)
random_3 = Random(Range=dom_3, Number=density_3, Seed=pattern_2)
random_4 = Random(Range=dom_3, Number=density_3, Seed=eval_7)
wbthicken = WeaverBirdsMeshThicken(Mesh=wbsplitpolygons, Distance=-4.5, OffsetType=0)
extr = Extrude(Base=rectangle.Rectangle, Direction=Z)
pt_2 = PointXYZ(XComponent=random_3, YComponent=random_4, ZComponent=0, System=PlaneXY(0, 0, 0))
wbcatmullclark = WeaverBirdsCatmullClarkSubdivision(MeshCurves=wbthicken, Level=2, SmoothNakedEdges=1)
bbox = BoundingBox(Content=extr, Plane=PlaneXY(0, 0, 0), UnionBox=True)  # -> Box, Box_2
series = Series(Start=0, Step=num, Count=order_2)  # -> graft(Series)
series_2 = Series(Start=0, Step=num, Count=order_2)  # -> graft(Series)
wblaplace = WeaverBirdsLaplacianSmoothing(MeshCurves=wbcatmullclark, Level=1, SmoothNakedEdges=1, Thin=1)
X = UnitX(Factor=series_2)
Y = UnitY(Factor=series)
xy = XYPlane(Origin=Point(15, 15, 0))
rad_3 = Radians(Degrees=45)
move_4 = Move(Geometry=pt_2, Motion=X)  # -> simplify(flatten(Geometry)), Transform
rad_4 = Radians(Degrees=-45)
move_5 = Move(Geometry=move_4.Geometry, Motion=Y)  # -> simplify(flatten(Geometry)), Transform
rotate_3 = Rotate(Geometry=pt, Angle=rad_4, Plane=xy)  # -> Geometry, Transform
voronoi = Voronoi(
    Points=flatten([move_5.Geometry, rotate_3.Geometry]),
    Radius=voronoi_radius_not_interesting,
    Box=bbox.Box,
    Plane=PlaneXY(0, 0, 0),
    BruteForceOverride=False)
tiled_voronoi = Geometry(voronoi)
wbcarpet = WeaverBirdsSierpinskiCarpet(MeshPolylines=tiled_voronoi, Distance=stroke_3, InsetType=0)
rotate_4 = Rotate(Geometry=wbcarpet, Angle=rad_3, Plane=xy)  # -> Geometry, Transform
wbthicken_2 = WeaverBirdsMeshThicken(Mesh=rotate_4.Geometry, Distance=2.5, OffsetType=0)
wbcatmullclark_2 = WeaverBirdsCatmullClarkSubdivision(MeshCurves=wbthicken_2, Level=2, SmoothNakedEdges=0)
wblaplace_2 = WeaverBirdsLaplacianSmoothing(MeshCurves=wbcatmullclark_2, Level=1, SmoothNakedEdges=0, Thin=1)
geo_2 = Geometry(wblaplace_2)
all = Geometry(flatten([geo_2, wblaplace, move_2.Geometry, move_3.Geometry]))

# ==== cluster Cluster
G = ClusterInput()
_0 = ClusterInput()
_1 = ClusterInput()
_2 = ClusterInput()
_3 = ClusterInput()
_4 = ClusterInput()
X = ClusterInput()
Y = ClusterInput()
Z = ClusterInput()
X_2 = ClusterInput()
Y_2 = ClusterInput()
Z_2 = ClusterInput()
X_3 = ClusterInput()
Y_3 = ClusterInput()
Z_3 = ClusterInput()
extrusion_vec = Vector(Vector(0, 0, 4.5))
face = ClusterInput()
bold = ClusterInput()
content = ClusterInput()
bool = Boolean(False)
G_2 = ClusterInput()

origin_point = Point(Point(0, 0, 0))
filter = StreamFilter(Gate=G, Stream0=_0, Stream1=_1, Stream2=_2, Stream3=_3, Stream4=_4)
location_4 = Plane(PlaneYZ(0, 40, 0))
location_5 = Plane(PlaneYZ(0, 40, 0))
pt = PointXYZ(XComponent=X, YComponent=Y, ZComponent=Z, System=PlaneXY(0, 0, 0))
pt_2 = PointXYZ(XComponent=X_2, YComponent=Y_2, ZComponent=Z_2, System=PlaneXY(0, 0, 0))
pt_3 = PointXYZ(XComponent=X_3, YComponent=Y_3, ZComponent=Z_3, System=PlaneXY(0, 0, 0))
yz = YZPlane(Origin=pt_2)
yz_2 = YZPlane(Origin=pt_3)
rad = Radians(Degrees="0")
padjust = AdjustPlane(Plane=yz, Normal=Vector(-12, 0, 0))
prot = RotatePlane(Plane=yz_2, Angle=rad)
xy = XYPlane(Origin=pt)
filter_2 = StreamFilter(Gate=G_2, Stream0=xy, Stream1=padjust, Stream2=prot, Stream3=location_4, Stream4=location_5)

servers_text_component = Servers_Text_Component(face=face, bold=bold, italics=bool, size=filter, content=content)  # -> out, A
# ---------- servers_text_component: VB ----------
    If(size = 0) Then
      size = 1
    End If


    Dim letters_plane As Rhino.Geometry.Plane
    letters_plane = Rhino.Geometry.Plane.WorldXY

    If(face <> Nothing And size > 0 And content <> Nothing) Then
      Dim te As System.Guid
      te = RhinoDoc.ActiveDoc.Objects.AddText(content, letters_plane, size, face, bold, italics)

      Dim txt As Rhino.DocObjects.TextObject
      txt = RhinoDoc.ActiveDoc.Objects.Find(te)

      Dim tt As Rhino.Geometry.TextEntity
      tt = txt.Geometry

      Dim curves() As Rhino.Geometry.Curve
      curves = tt.Explode()

      Dim curvesNum As Integer
      curvesNum = curves.GetUpperBound(0)


      Dim guids(curvesNum) As Guid
      For i As Integer = 0 To curvesNum
        Dim g As Guid
        g = RhinoDoc.ActiveDoc.Objects.AddCurve(curves(i))
        guids(i) = g
      Next
      A = guids
    End If
# ---------- end servers_text_component ----------
crv = Curve(servers_text_component.A)
Z_4 = UnitZ(Factor=extrusion_vec)
planar = PlanarSrf(Edges=crv)
xy_2 = XYPlane(Origin=Point(0, 0, 0))
extr = Extrude(Base=planar, Direction=Z_4)
cap = CapHoles(Brep=extr)
bbox = BoundingBox(Content=cap, Plane=PlaneXY(0, 0, 0), UnionBox=True)  # -> Box, Box_2
orient = Orient(Geometry=planar, Source=xy_2, Target=filter_2)  # -> Geometry, Transform
explode = BrepComponents(Brep=bbox.Box)  # -> Faces, Edges, Vertices
pcen = PolygonCenter(Polyline=explode.Faces)  # -> CenterV, CenterE
center = Point(Point(15, 15, 0))
item = ListItem(List=pcen.CenterV, Index=Slider(4, range=0..10), Wrap=False)
item_2 = ListItem(List=pcen.CenterV, Index=Slider(1, range=0..10), Wrap=False)
item_3 = ListItem(List=pcen.CenterV, Index=Slider(3, range=0..10), Wrap=False)
pcomp = Decompose(Point=item_2, System=PlaneXY(0, 0, 0))  # -> XComponent, YComponent, ZComponent
pcomp_2 = Decompose(Point=item_3, System=PlaneXY(0, 0, 0))  # -> XComponent, YComponent, ZComponent
subtraction = Subtraction(A=center, B=item)
move = Move(Geometry=planar, Motion=subtraction)  # -> Geometry, Transform
subtraction_2 = Subtraction(A=pcomp.XComponent, B=pcomp_2.XComponent)
eval = Evaluate(F="32/x", x=subtraction_2)
scale = Scale(Geometry=move.Geometry, Center=center, Factor=eval)  # -> Geometry, Transform
G_3 = ClusterOutput(move.Geometry)
